# Grasshopper definition XX_align planes - code.gh (Grasshopper 1.0.7)
# Copyright: Co-de-iT
# plug-ins: CurlNoise, FileToScript, Anemone

n_of_planes = Slider(3000, range=10..5000)
# align and move
box = Box({Plane=Plane(origin=(0, 0, 0), x=(0, 1, 0), y=(1, 0, 0)), X=Domain(0, 10), Y=Domain(0, 10), Z=Domain(-10, 0)})
n_of_planes_2 = Slider(2000, range=10..5000)

# ---- group: containing volume
# align only (no move)
box_2 = Box({Plane=Plane(origin=(0, 0, 0), x=(0, 1, 0), y=(1, 0, 0)), X=Domain(0, 10), Y=Domain(0, 10), Z=Domain(-10, 0)})

# ----
plane_radius = Slider(0.25, range=0..1)

# ---- group: volumetric grid
c_script = CSharpScript(B=box, n=Slider(30, range=0..100))  # -> out, A; inputs B: Brep, n: Int32
# ---------- c_script: C# ----------
    BoundingBox b1 = B.GetBoundingBox(false);

    DataTree<Point3d> pts = new DataTree<Point3d>();
    GH_Path path;

    double step = 1.0 / (double) n;

    for (int i = 0; i < n + 1; i++)
      for (int j = 0; j < n + 1; j++)
      {
        path = new GH_Path(i, j);
        for (int k = 0; k < n + 1; k++)
          pts.Add(b1.PointAt(i * step, j * step, k * step));
      }

    A = pts;
# ---------- end c_script ----------

# ----
_3d = BooleanToggle(True)
number_slider = Slider(0.6, range=0..1)
number_slider_2 = Slider(0.121, range=0..1)
cs_file_to_sync = Panel("F:\Users\alessio\Documents\Co-de-iT\Design By Data Master Paris\2019\workshop\Agent_Bodies\Agent_Bodies\Align Planes-begin.cs")
random_vector = CSharpScript(n=n_of_planes, seed=Slider(0, range=0..100), DDD=_3d)  # -> out, V; inputs n: Int32, seed: Int32, DDD: Boolean
# ---------- random_vector: C# usings ----------
using System.IO;
using System.Linq;
using System.Data;
using System.Drawing;
using System.Reflection;
using System.Windows.Forms;
using System.Xml;
using System.Xml.Linq;
using System.Runtime.InteropServices;

using Rhino.DocObjects;
using Rhino.Collections;
using GH_IO;
using GH_IO.Serialization;
# ---------- random_vector: C# ----------
    if(seed == 0) rnd = new Random(); else rnd = new Random(seed);
    List <Vector3d> vectors = new List<Vector3d>();
    Vector3d vec = new Vector3d();
    for (int i = 0; i < n; i++){
      vec.X = rnd.NextDouble() - 0.5;
      vec.Y = rnd.NextDouble() - 0.5;
      vec.Z = DDD ? rnd.NextDouble() - 0.5 : 0;
      vec.Unitize();
      vectors.Add(vec);
    }
    V = vectors;
# ---------- random_vector: C# additional code ----------
  Random rnd;
# ---------- end random_vector ----------

# ---- group: random vectors 3D
random_vector_2 = CSharpScript(n=n_of_planes_2, S=Slider(30, range=0..100))  # -> out, V; inputs n: Int32, S: Int32
# ---------- random_vector_2: C# ----------
    Print(S.ToString());
    if (S == 0) rnd = new Random(); else rnd = new Random(S);
    List <Vector3d> vectors = new List<Vector3d>();
    Vector3d vec = new Vector3d();
    for (int i = 0; i < n; i++){
      vec.X = rnd.NextDouble() - 0.5;
      vec.Y = rnd.NextDouble() - 0.5;
      vec.Z = rnd.NextDouble() - 0.5;
      vec.Unitize();
      vectors.Add(vec);
    }
    V = vectors;
# ---------- random_vector_2: C# additional code ----------
  Random rnd;
# ---------- end random_vector_2 ----------

# ----
pop3d = Populate3D(Region=box, Count=n_of_planes, Seed=1)
pop3d_2 = Populate3D(Region=box_2, Count=n_of_planes_2, Seed=1)

# ---- group: field
curl = CurlNoise(Points=pop3d_2, Scale=Slider(0.121, range=0..1), Offset=Slider(0.6, range=0..1), _3D="true")  # -> CurlVector, Colour

# ----
curl_2 = CurlNoise(Points=c_script.A, Scale=number_slider_2, Offset=number_slider, _3D="true")  # -> CurlVector, Colour
unit = UnitVector(Vector=curl.CurlVector)
reset = Button()
reset_2 = Button()
amp = Amplitude(Vector=curl_2.CurlVector, Amplitude=Slider(0.25, range=0..1))
panel = Panel("""<title>

<description>

code by <author>

v <version>""")

# ---- group: initial points preview
vdisex = VectorDisplayEx(Point=pop3d, Vector=random_vector.V, Colour=random_vector.V, Width="1")

# ----
loop_start = LoopStart(N=Slider(100, range=0..100), T=reset, D0=pop3d, D1=random_vector.V)  # -> port, Counter, Data, Data_2; disabled

# ---- group: field preview
vdisex_2 = VectorDisplayEx(Point=c_script.A, Vector=amp, Colour=curl_2.Colour, Width="1")

# ---- group: initial points preview
vdisex_3 = VectorDisplayEx(Point=pop3d_2, Vector=random_vector_2.V, Colour=random_vector_2.V, Width=2)

# ---- group: field preview
vdisex_4 = VectorDisplayEx(Point=pop3d_2, Vector=unit, Colour=curl.Colour, Width="1")

# ----
loop_start_2 = LoopStart(Repeat=Slider(100, range=0..100), Trigger=reset_2, Data=random_vector_2.V)  # -> port, Counter, Data; disabled

# ---- group: find neighbours
max_neighbours = Panel("3")
prox = Proximity3D(Points=pop3d_2, Group=max_neighbours, MinRadius=Slider(0.108, range=0..5), MaxRadius=Slider(1.853, range=0..5))  # -> Links, Topology

# everything farther than a certain distance will not separate anymore
number_slider_3 = Slider(5, range=0..5)
max_neighbours_2 = Panel("5")
prox_2 = Proximity3D(Points=loop_start.Data, Group=max_neighbours_2, MinRadius=Slider(0.108, range=0..5), MaxRadius=number_slider_3)  # -> Links, Topology

# ----
panel_2 = Panel(loop_start.Counter)
panel_3 = Panel(loop_start_2.Counter)
plane_radius_2 = Slider(0.212, range=0..1)
max_force = Slider(0.097, range=0..1)
pt = Point(pop3d)
vec = Vector(random_vector.V)
# P - points
# V - vectors (initial directions)
# cNs - curl noise scale
# cNT - curl noise time
# pR - plane Radius
# cI - cohesion Intensity
# aI - alignment Intensity
# sI - separation Intensity
# fI field Intensity
# mF - maxForce
curl_3 = CurlNoise(Points=pt, Scale=number_slider_2, Offset=number_slider, _3D="true")  # -> CurlVector, Colour
path = FilePath(cs_file_to_sync)

curl_4 = CurlNoise(Points=loop_start.Data, Scale=number_slider_2, Offset=number_slider, _3D="true")  # -> CurlVector, Colour
unit_2 = UnitVector(Vector=curl_4.CurlVector)
item = ListItem(List=loop_start.Data_2, Index=prox_2.Topology, Wrap=True)
proximity_intensity = Slider(0.724, range=0..1)
field_intensity = Slider(0.189, range=0..1)
avr = Average(Input=item)
unit_3 = UnitVector(Vector=avr)
multiplication = Multiplication(A=graft(unit_2), B=field_intensity)
multiplication_2 = Multiplication(A=unit_3, B=proximity_intensity)
addition = Addition(A=multiplication_2, B=multiplication)
unit_4 = UnitVector(Vector=addition)
max_force_2 = Slider(0.25, range=0..1)

c_script_2 = CSharpScript(
    reset=Button(),
    on=Toggle(False),
    P=pt,
    V=vec,
    cNS=number_slider_2,
    cNT=number_slider,
    pR=plane_radius_2,
    mF=max_force,
    Reference="C:\Users\Alessio\AppData\Roaming\Grasshopper\Libraries\SimplexNoise.dll")  # -> out, Planes, MeshPlanes; inputs reset: Boolean, on: Boolean, P: list of Point3d, V: list of Vector3d, cNS: Double, cNT: Double, pR: Double, cI: Double, aI: Double, sI: Double, fI: Double, mF: Double
# ---------- c_script_2: C# usings ----------
 
using System.Threading;
using System.Threading.Tasks;
using System.Drawing;
using SimplexNoise;
# ---------- c_script_2: C# ----------
 

        // align planes with field - C#
        // code by Alessio Erioli - (c) Co-de-iT 2019 


        if (P == null || P.Count == 0) return;

        if (reset || aPS == null)
        {
            // passing the essential parameters to the new simulation
            aPS = new AgentPlaneSimulation(P, V, cNS, cNT, pR, cI, aI, sI, fI, mF);
            gP = new GH_Plane[aPS.agentPlanes.Length];
            gM = new GH_Mesh[aPS.agentPlanes.Length];
        }
        else
        {

            // run simulation
            aPS.Run();

            // extract planes

            Parallel.For(0, aPS.agentPlanes.Length, i =>
            {
                gP[i] = new GH_Plane(aPS.agentPlanes[i].PlaneOut());
                //gM[i] = new GH_Mesh(aPS.agentPlanes[i].MeshOut(pR));
            });


            Planes = gP;
            //MeshPlanes = gM;

            if (on) Component.ExpireSolution(true); // equivalent to a timer
        }
# ---------- c_script_2: C# additional code ----------
 

    // global variables for geometry output
    public GH_Plane[] gP;
    public GH_Mesh[] gM;

    public AgentPlaneSimulation aPS;

    // .............................................................................
    // ............................. classes .......................................
    // .............................................................................

    public class AgentPlaneSimulation
    {
        // ..........................    fields

        public double cNS;
        public double cNT;
        public double pR;
        public double cI;
        public double aI;
        public double sI;
        public double fI;
        public double mF;

        public AgentPlane[] agentPlanes;

        // ..........................    constructor

        public AgentPlaneSimulation(List<Point3d> P, List<Vector3d> V, double cNS, double cNT, double pR, double cI, double aI, double sI, double fI, double mF)
        {

            this.cNS = cNS;
            this.cNT = cNT;
            this.pR = pR;
            this.cI = cI;
            this.aI = aI;
            this.sI = sI;
            this.fI = fI;
            this.mF = mF;

            // build agent planes array
            agentPlanes = new AgentPlane[P.Count];

            Parallel.For(0, P.Count, i =>
            {
                agentPlanes[i] = new AgentPlane(P[i], V[i]);
            });

        }

        // ..........................    methods

        public void Run()
        {
            AlignWitCurlNoise();
        }

        public void AlignWitCurlNoise()
        {
            // calculate curl noise vector for agents

            Vector3d[] curlNoiseVector = new Vector3d[agentPlanes.Length];
            Parallel.For(0, agentPlanes.Length, i =>
            {
                CurlNoise(agentPlanes[i].O, cNS, cNT, true, out curlNoiseVector[i]);
                curlNoiseVector[i].Unitize();
                agentPlanes[i].Align(curlNoiseVector[i], mF);
            });


        }
    }

    public class AgentPlane
    {

        // fields
        public Point3d O;
        public Vector3d X, Y, Z;

        // constructor
        public AgentPlane(Point3d O, Vector3d dirX)
        {
            this.O = O;
            dirX.Unitize();
            this.X = dirX;
        }
        // methods

        public void Align(Vector3d desired, double aI)
        {

            X = X * (1 - aI) + desired * aI;
            X.Unitize();
        }

        public Plane PlaneOut()
        {
            Vector3d oV = new Vector3d(O);
            oV.Unitize();
            this.Y = Vector3d.CrossProduct(X, oV);
            return new Plane(O, X, Y);
        }

        public GH_Mesh MeshOut(double rad)
        {
            Plane pl = PlaneOut();
            Transform x = Transform.PlaneToPlane(Plane.WorldXY, pl);

            Mesh m = new Mesh();
            Point3d[] verts = new Point3d[] { new Point3d(-1, -1, 0), new Point3d(1, -1, 0), new Point3d(1, 1, 0), new Point3d(-1, 1, 0) };
            m.Vertices.AddVertices(verts);
            m.Faces.AddFace(0, 1, 2, 3);
            m.Scale(rad);
            m.Transform(x);
            m.Normals.ComputeNormals();

            GH_Mesh m1 = new GH_Mesh(m);
            return m1;
        }
    }


    // .............................................................................
    // ..................... 3D Curl Noise function ................................
    // .............................................................................

    static void CurlNoise(Point3d P, double S, double t, bool flag, out Vector3d V)
    // Points, scale, time, 3D, out vectors
    {

        float fS = (float)S;
        float fT = (float)t;
        float nX = (float)P.X * fS + fT; // num5
        float nY = (float)P.Y * fS + fT; // num6
        float nZ = (float)P.Z * fS + fT; // num7

        double num8 = Noise.Generate(nX, nY, nZ);
        float dT = 1f;
        float nPlus = Noise.Generate(nX, nY + dT, nZ);
        float nMinus = Noise.Generate(nX, nY - dT, nZ);
        float nDiff = (nPlus - nMinus) / (2f * dT);
        nPlus = Noise.Generate(nX, nY, nZ + dT);
        nMinus = Noise.Generate(nX, nY, nZ - dT);
        float num13 = (nPlus - nMinus) / (2f * dT);
        float num14 = nDiff - num13;
        nX -= fT;
        nY -= fT;
        nPlus = Noise.Generate(nX, nY, nZ + dT);
        nMinus = Noise.Generate(nX, nY, nZ - dT);
        nDiff = (nPlus - nMinus) / (2f * dT);
        nPlus = Noise.Generate(nX + dT, nY, nZ);
        nMinus = Noise.Generate(nX - dT, nY, nZ);
        num13 = (nPlus - nMinus) / (2f * dT);
        float num15 = nDiff - num13;
        nPlus = Noise.Generate(nX + dT, nY, nZ);
        nMinus = Noise.Generate(nX - dT, nY, nZ);
        nDiff = (nPlus - nMinus) / (2f * dT);
        nPlus = Noise.Generate(nX, nY + dT, nZ);
        nMinus = Noise.Generate(nX, nY - dT, nZ);
        num13 = (nPlus - nMinus) / (2f * dT);
        float num16 = nDiff - num13;
        Vector3d val2 = new Vector3d((double)num14, (double)num15, (double)num16);
        if (!flag)
        {
            nPlus = Noise.Generate(nX, nY + dT);
            nMinus = Noise.Generate(nX, nY - dT);
            nDiff = (nPlus - nMinus) / (2f * dT);
            nPlus = Noise.Generate(nX + dT, nY);
            nMinus = Noise.Generate(nX - dT, nY);
            nDiff = (nPlus - nMinus) / (2f * dT);
            val2 = new Vector3d((double)nDiff, (double)(0f - num13), 0.0);
        }
        V = val2;

    }

    // .............................................................................
    // ............................. Utilities .....................................
    // .............................................................................

    public float Remap(float val, float from1, float to1, float from2, float to2)
    {
        return (val - from1) / (to1 - from1) * (to2 - from2) + from2;
    }

    public GH_Colour Vec2Col(Vector3d v)
    {
        v.Unitize();
        int red = (int)Math.Floor(Remap((float)v.X, -1f, 1f, 0f, 255f));
        int green = (int)Math.Floor(Remap((float)v.Y, -1f, 1f, 0f, 255f));
        int blue = (int)Math.Floor(Remap((float)v.Z, -1f, 1f, 0f, 255f));
        return new GH_Colour(Color.FromArgb(red, green, blue));
    }
# ---------- end c_script_2 ----------
neighbours_indexes = Panel(prox.Topology)
ftsv2 = FileToScriptV2(File=path)
vec_2 = Vector(curl_3.CurlVector)
vlen = VectorLength(Vector=vec_2)

# ---- group: alignment behavior
item_2 = ListItem(List=loop_start_2.Data, Index=prox.Topology, Wrap=True)
avr_2 = Average(Input=item_2)
unit_5 = UnitVector(Vector=avr_2)

# ----
len = Length(Curve=prox_2.Links)
multiplication_3 = Multiplication(A=plane_radius, B="3")
smaller = SmallerThan(FirstNumber=len, SecondNumber=multiplication_3)  # -> SmallerThan, OrEqualTo
dispatch = Dispatch(List=prox_2.Topology, DispatchPattern=smaller.SmallerThan)  # -> ListA, ListB

bar_graph = BarGraph(vlen, BarColor=RGB(255, 0, 90))
cluster = Cluster(plane=c_script_2.Planes, plane_radius=Slider(0.248, range=0..1))
generic_messages = Panel(c_script_2.out)

# ---- group: defines desired vector
proximity_intensity_2 = Slider(0.343, range=0..1)
field_intensity_2 = Slider(0.429, range=0..1)
multiplication_4 = Multiplication(A=graft(unit), B=field_intensity_2)
multiplication_5 = Multiplication(A=unit_5, B=proximity_intensity_2)
addition_2 = Addition(A=multiplication_5, B=multiplication_4)
unit_6 = UnitVector(Vector=addition_2)

# ---- group: intial values
proximity_intensity_3 = Slider(0.724, range=0..1)
field_intensity_3 = Slider(0.189, range=0..1)

# ----
deplane = DeconstructPlane(Plane=c_script_2.Planes)  # -> Origin, XAxis, YAxis, ZAxis
number_slider_4 = Slider(0.25, range=0..1)
preview = CustomPreview(Geometry=cluster, Material=ColourSwatch(SwatchColor=RGB(255, 255, 255)))
unit_7 = UnitVector(Vector=vec_2)

item_3 = ListItem(List=loop_start.Data, Index=prox_2.Topology, Wrap=True)
cohesion_intensity = Slider(0.026, range=0..1)
avr_3 = Average(Input=item_3)  # -> flatten(ArithmeticMean)
vec2pt = Vector2Pt(PointA=loop_start.Data, PointB=avr_3, Unitize=False)  # -> Vector, Length
multiplication_6 = Multiplication(A=vec2pt.Vector, B=cohesion_intensity)
amp_2 = Amplitude(Vector=vec2pt.Vector, Amplitude=cohesion_intensity)

angle = Angle(VectorA=vec_2, VectorB=deplane.XAxis)  # -> Angle, Reflex
amp_3 = Amplitude(Vector=vec_2, Amplitude=number_slider_4)
amp_4 = Amplitude(Vector=deplane.XAxis, Amplitude=number_slider_4)

# ---- group: alignment check
alignment_control = QuickGraph(angle.Angle, SortOrder=0)

# ----
vdisex_5 = VectorDisplayEx(Point=deplane.Origin, Vector=amp_3, Colour=unit_7, Width="1")
vdisex_6 = VectorDisplayEx(Point=deplane.Origin, Vector=amp_4, Colour=RGB(0, 0, 0), Width="1")

# ---- group: alignment / steering vector
subtraction = Subtraction(A=unit_4, B=graft(loop_start.Data_2))

# ----
maxforce = Slider(0.05, range=0..1)
maxforce_2 = Slider(0.05, range=0..1)

# ---- group: alignment
multiplication_7 = Multiplication(A=subtraction, B=max_force_2)
addition_3 = Addition(A=graft(loop_start.Data_2), B=multiplication_7)

# ---- group: steer = desired - speed
subtraction_2 = Subtraction(A=unit_6, B=graft(loop_start_2.Data))

# ---- group: limit speed with maxForce
# try both methods and check results
amp_5 = Amplitude(Vector=subtraction_2, Amplitude=maxforce_2)
multiplication_8 = Multiplication(A=subtraction_2, B=maxforce)

# ----
addition_4 = Addition(A=graft(loop_start_2.Data), B=multiplication_8)
unit_8 = UnitVector(Vector=addition_4)  # -> simplify(flatten(Vector))
loop_end = LoopEnd(port=loop_start_2.port, Exit=False, Data=unit_8, TimeOutVal=0, pausedState=False, state="Constant output")
unit_9 = UnitVector(Vector=addition_3)  # -> simplify(flatten(Vector))

# ---- group: preview vectors
# direction
# steer
# desired
swatch = ColourSwatch(SwatchColor=RGB(255, 255, 255))
move = Move(Geometry=pop3d_2, Motion=loop_end)  # -> Geometry, Transform
vdisex_7 = VectorDisplayEx(Point=move.Geometry, Vector=flatten(multiplication_8), Colour=swatch, Width=2)
vdisex_8 = VectorDisplayEx(Point=pop3d_2, Vector=flatten(unit_6), Colour=ColourSwatch(SwatchColor=RGB(161, 95, 144)), Width=2)
# alignment
vdisex_9 = VectorDisplayEx(Point=pop3d_2, Vector=loop_end, Colour=RGB(0, 0, 0), Width=2)

# ---- group: plane Y vector
# the position sets the origin, the orientation vector is the X axis and the cross product between orientation vector and origin point is the Y
xprod = CrossProduct(VectorA=pop3d_2, VectorB=loop_end, Unitize=True)  # -> Vector, Length

# ----
plane_radius_3 = Slider(0.5, range=0..1)

# ---- group: plane Z vector
xprod_2 = CrossProduct(VectorA=loop_end, VectorB=xprod.Vector, Unitize=True)  # -> Vector, Length

# ---- group: plane
pl = ConstructPlane(Origin=pop3d_2, XAxis=loop_end, YAxis=xprod.Vector)

# ----
number_slider_5 = Slider(0.177, range=0..1)
pln = Plane([Plane(origin=(1.107439772, 2.486685842, 5.329893201), x=(-0.4986065825, -0.3737708271, 0.7821041137), y=(0.736199743, -0.658904909, 0.1544482416)), Plane(origin=(7.737039969, 8.564648134, 9.111530999), x=(0.6313497429, -0.6177262295, 0.4688409193), y=(0.6797393374, 0.1497869656, -0.7179960293)), Plane(origin=(9.516898365, 0.960044973, 5.174120513), x=(0.06754764495, -0.7872200112, -0.6129616379), y=(0.3361304946, 0.596404943, -0.7289152451)), Plane(origin=(9.451836482, 8.611707454, 0.2795030085), x=(0.5822428151, 0.3774502994, -0.7200865058), y=(-0.6631927726, 0.7328285453, -0.1521107148)), Plane(origin=(0.1268575574, 8.683155635, 0.3600956688), x=(0.6474369355, -0.7273328192, 0.2276233394), y=(0.3645451364, 0.03326631567, -0.9305913151)), Plane(origin=(5.100827089, 1.020646925, 9.849754767), x=(-0.2654628733, 0.2418112793, -0.9333042205), y=(-0.7862234292, 0.5059869432, 0.3547251511))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])
number_slider_6 = Slider(0.177, range=0..1)

# ---- group: mesh plane
cluster_2 = Cluster(plane=pl, plane_radius=plane_radius_3)

# ----
amp_6 = Amplitude(Vector=xprod.Vector, Amplitude=number_slider_6)
amp_7 = Amplitude(Vector=loop_end, Amplitude=number_slider_6)
vdisex_10 = VectorDisplayEx(Point=pop3d_2, Vector=amp_6, Colour=ColourSwatch(SwatchColor=RGB(53, 212, 0)), Width=2)
vdisex_11 = VectorDisplayEx(Point=pop3d_2, Vector=amp_7, Colour=ColourSwatch(SwatchColor=RGB(255, 0, 0)), Width=2)
preview_2 = CustomPreview(Geometry=cluster_2, Material=xprod_2.Vector)
preview_3 = CustomPreview(Geometry=cluster_2, Material=ColourSwatch(SwatchColor=RGB(255, 255, 255)))

item_4 = ListItem(List=loop_start.Data, Index=dispatch.ListA, Wrap=True)
separation_intensity = Slider(0.12, range=0..1)
avr_4 = Average(Input=item_4)  # -> flatten(ArithmeticMean)
vec2pt_2 = Vector2Pt(PointA=avr_4, PointB=loop_start.Data, Unitize=False)  # -> Vector, Length
amp_8 = Amplitude(Vector=vec2pt_2.Vector, Amplitude=separation_intensity)

# ---- group: replace nulls with zero vectors
vec_3 = Vector(Vector(0, 0, 0))
nullrep = ReplaceNulls(Items=vec2pt_2.Vector, Replacements=vec_3)  # -> Items, Count

# ----
multiplication_9 = Multiplication(A=nullrep.Items, B=separation_intensity)

# ---- group: movement vector
addition_5 = Addition(A=multiplication_6, B=multiplication_9)

# ----
move_2 = Move(Geometry=loop_start.Data, Motion=addition_5)  # -> flatten(Geometry), Transform
loop_end_2 = LoopEnd(
    port=loop_start.port,
    Exit=False,
    Data=move_2.Geometry,
    Data_2=unit_9,
    TimeOutVal=0,
    pausedState=False,
    state="Constant output")  # -> D0, D1

# ----
# direction
# steer
# desired
swatch_2 = ColourSwatch(SwatchColor=RGB(255, 255, 255))
move_3 = Move(Geometry=loop_end_2.D0, Motion=loop_end_2.D1)  # -> Geometry, Transform
# alignment
vdisex_12 = VectorDisplayEx(Point=move_3.Geometry, Vector=flatten(multiplication_7), Colour=swatch_2, Width=2)
vdisex_13 = VectorDisplayEx(Point=loop_end_2.D0, Vector=flatten(unit_4), Colour=ColourSwatch(SwatchColor=RGB(161, 95, 144)), Width=2)
vdisex_14 = VectorDisplayEx(Point=loop_end_2.D0, Vector=loop_end_2.D1, Colour=RGB(0, 0, 0), Width=2)

# ----
# movement
swatch_3 = ColourSwatch(SwatchColor=RGB(255, 0, 0))
vdisex_15 = VectorDisplayEx(Point=loop_end_2.D0, Vector=addition_5, Colour=swatch_3, Width=2)

# ---- group: plane Y vector
# the position sets the origin, the orientation vector is the X axis and the cross product between orientation vector and origin point is the Y
xprod_3 = CrossProduct(VectorA=loop_end_2.D0, VectorB=loop_end_2.D1, Unitize=True)  # -> Vector, Length

# ---- group: plane Z vector
xprod_4 = CrossProduct(VectorA=loop_end_2.D1, VectorB=xprod_3.Vector, Unitize=True)  # -> Vector, Length

# ---- group: plane
pl_2 = ConstructPlane(Origin=loop_end_2.D0, XAxis=loop_end_2.D1, YAxis=xprod_3.Vector)

# ---- group: vec to col
c_script_3 = CSharpScript(V=xprod_4.Vector)  # -> out, C; inputs V: Vector3d
# ---------- c_script_3: C# usings ----------
using System.Drawing;
# ---------- c_script_3: C# ----------
    if (V == null) return;
    
    C = MapVecToCol(V);
# ---------- c_script_3: C# additional code ----------
  public Color MapVecToCol(Vector3d V)
  {
    return Color.FromArgb((int) ((V.X + 1) * 0.5 * 255), (int) ((V.Y + 1) * 0.5 * 255),
      (int) ((V.Z + 1) * 0.5 * 255));
  }
# ---------- end c_script_3 ----------

# ---- group: mesh plane
cluster_3 = Cluster(plane=pl_2, plane_radius=plane_radius)

# ----
amp_9 = Amplitude(Vector=xprod_3.Vector, Amplitude=number_slider_5)
amp_10 = Amplitude(Vector=loop_end_2.D1, Amplitude=number_slider_5)
preview_4 = CustomPreview(Geometry=cluster_3, Material=xprod_4.Vector)
vdisex_16 = VectorDisplayEx(Point=loop_end_2.D0, Vector=amp_9, Colour=ColourSwatch(SwatchColor=RGB(53, 212, 0)), Width=2)
vdisex_17 = VectorDisplayEx(Point=loop_end_2.D0, Vector=amp_10, Colour=ColourSwatch(SwatchColor=RGB(255, 0, 0)), Width=2)

# ==== cluster Cluster
plane_radius = ClusterInput()
plane = ClusterInput()

# ---- group: create a mesh quad face
panel = Panel("""{-1,-1,0}
{1,-1,0}
{1,1,0}
{-1,1,0}""")
conmesh = ConstructMesh(Vertices=panel, Faces={A=0, B=1, C=2, D=3})
scale = Scale(Geometry=conmesh, Center=Point(0, 0, 0), Factor=plane_radius)  # -> Geometry, Transform

# ----
orient = Orient(Geometry=scale.Geometry, Source=PlaneXY(0, 0, 0), Target=plane)  # -> Geometry, Transform
mesh_plane = ClusterOutput(orient.Geometry)
